# Grasshopper definition GrasshopperToPython_Alex-Sola.gh (Grasshopper 1.0.7)

path = FilePath("C:\Users\Alex\Desktop\Visual Code\GrasshopperToPython_Alex-Sola.py")
number_slider = Slider(20, range=0..20)
file = ReadFile(File=path, PerLineParse=False)
python = GhPythonScript(Code=file, X=number_slider, Y=number_slider)  # -> Out, A, B, C, D, E, F, G
list = ValueList({"Surface": 0, "Mesh": 1}, selected="Surface")
filter = StreamFilter(Gate=list, Stream0=python.F, Stream1=python.G)
geo = Geometry(filter)
mirror = Mirror(Geometry=geo, Plane=PlaneYZ(0, 0, 0))  # -> Geometry, Transform
xz = XZPlane(Origin=Point(0, 0, 0))
mirror_2 = Mirror(Geometry=[geo, mirror.Geometry], Plane=xz)  # -> Geometry, Transform
geo_2 = Geometry([geo, mirror.Geometry, mirror_2.Geometry])
